# Grasshopper definition case.gh (Grasshopper 1.0.8)

crv = Curve(<curve referenced from the Rhino model>)
crv_2 = Curve([<curve referenced from the Rhino model> x21])
crv_3 = Curve(<curve referenced from the Rhino model>)
crv_4 = Curve(<curve referenced from the Rhino model>)
crv_5 = Curve([<curve referenced from the Rhino model> x21])
crv_6 = Curve([<curve referenced from the Rhino model> x2])
crv_7 = Curve([<curve referenced from the Rhino model> x21])
rdiff = RegionDifference(CurvesA=crv, CurvesB=crv_2)
runion = RegionUnion(Curves=crv_6)
crv_8 = Curve([<curve referenced from the Rhino model> x21])
crv_9 = Curve(<curve referenced from the Rhino model>)
crv_10 = Curve(<curve referenced from the Rhino model>)
boundary = BoundarySurfaces(Edges=rdiff)
runion_2 = RegionUnion(Curves=crv_3)
crv_11 = Curve(<curve referenced from the Rhino model>)
rdiff_2 = RegionDifference(CurvesA=crv_4, CurvesB=crv_3)
crv_12 = Curve(<curve referenced from the Rhino model>)
number_slider = Slider(1.6, range=0..10)
rdiff_3 = RegionDifference(CurvesA=rdiff_2, CurvesB=crv_5)
number_slider_2 = Slider(10, range=0..10)
Z = UnitZ(Factor=Slider(10, range=0..10))
boundary_2 = BoundarySurfaces(Edges=crv_7)
rdiff_4 = RegionDifference(CurvesA=runion, CurvesB=crv_8)
boundary_3 = BoundarySurfaces(Edges=crv_10)
neg = Negative(Value=Z)
boundary_4 = BoundarySurfaces(Edges=crv_11)
boundary_5 = BoundarySurfaces(Edges=crv_12)
move = Move(Geometry=crv_5, Motion=neg)  # -> Geometry, Transform
boundary_6 = BoundarySurfaces(Edges=rdiff_3)
number_slider_3 = Slider(2.2, range=0..10)
Z_2 = UnitZ(Factor=Slider(1.6, range=0..10))
Z_3 = UnitZ(Factor=Slider(20, range=0..100))
number_slider_4 = Slider(2, range=0..10)
Z_4 = UnitZ(Factor=number_slider)
Z_5 = UnitZ(Factor=Slider(1.6, range=0..10))
boundary_7 = BoundarySurfaces(Edges=crv_9)
Z_6 = UnitZ(Factor=Slider(1.6, range=0..10))
extr = Extrude(Base=boundary_6, Direction=Z_2)
extr_2 = Extrude(Base=move.Geometry, Direction=Z_3)
addition = Addition(A=number_slider_3, B=Slider(3.1, range=0..10))
boundary_8 = BoundarySurfaces(Edges=rdiff_4)
number_slider_5 = Slider(6.4, range=0..10)
Z_7 = UnitZ(Factor=addition)
move_2 = Move(Geometry=boundary_3, Motion=Z_4)  # -> Geometry, Transform
move_3 = Move(Geometry=boundary, Motion=Z_5)  # -> Geometry, Transform
move_4 = Move(Geometry=boundary_5, Motion=Z_6)  # -> Geometry, Transform
Z_8 = UnitZ(Factor=Slider(8.5, range=0..10))
addition_2 = Addition(A=number_slider, B=number_slider_4)
Z_9 = UnitZ(Factor=number_slider_3)
neg_2 = Negative(Value=number_slider_4)
cap = CapHoles(Brep=extr_2)
Z_10 = UnitZ(Factor=neg_2)
brep = Brep(<brep referenced from the Rhino model>)
extr_3 = Extrude(Base=boundary_7, Direction=Z_7)
move_5 = Move(Geometry=crv_6, Motion=Z_7)  # -> Geometry, Transform
Z_11 = UnitZ(Factor=number_slider_5)
Z_12 = UnitZ(Factor=Slider(2.2, range=0..10))
extr_4 = Extrude(Base=boundary_2, Direction=Z_8)
move_6 = Move(Geometry=crv_6, Motion=Z_9)  # -> Geometry, Transform
sdiff = SolidDifference(BrepsA=brep, BrepsB=cap)
extr_5 = Extrude(Base=boundary_8, Direction=Z_9)
move_7 = Move(Geometry=boundary_4, Motion=Z_10)  # -> Geometry, Transform
extr_6 = Extrude(Base=move_3.Geometry, Direction=Z_12)
addition_3 = Addition(A=addition_2, B=number_slider_5)
crv_13 = Curve(<curve referenced from the Rhino model>)
crv_14 = Curve(<curve referenced from the Rhino model>)
Z_13 = UnitZ(Factor=Slider(7, range=0..10))
extr_7 = Extrude(Base=move_2.Geometry, Direction=Z_11)
extr_8 = Extrude(Base=move_4.Geometry, Direction=Z_13)
addition_4 = Addition(A=addition_3, B=Slider(1.5, range=0..10))
boundary_9 = BoundarySurfaces(Edges=crv_14)
boundary_10 = BoundarySurfaces(Edges=crv_13)
sunion = SolidUnion(Breps=[extr, extr_6])
Z_14 = UnitZ(Factor=addition_4)
Z_15 = UnitZ(Factor=Slider(7, range=0..10))
Z_16 = UnitZ(Factor=Slider(3, range=0..10))
extr_9 = Extrude(Base=move_7.Geometry, Direction=Z_14)
extr_10 = Extrude(Base=boundary_9, Direction=Z_15)
extr_11 = Extrude(Base=boundary_10, Direction=Z_16)
cap_2 = CapHoles(Brep=extr_10)
cap_3 = CapHoles(Brep=extr_11)
crv_15 = Curve([<curve referenced from the Rhino model> x2])
offset = OffsetSurface(Distance=Slider(5.1, range=0..10), Retrim=True)
Z_17 = UnitZ(Factor=Slider(1.6, range=0..10))
runion_3 = RegionUnion(Curves=crv_15)
move_8 = Move(Geometry=runion_3, Motion=Z_17)  # -> Geometry, Transform
Z_18 = UnitZ(Factor=Slider(10, range=0..10))
brep_2 = Brep(<brep referenced from the Rhino model>)
extr_12 = Extrude(Base=move_8.Geometry, Direction=Z_18)
cap_4 = CapHoles(Brep=brep_2)
