# Grasshopper definition nii-v3-choc.gh (Grasshopper 1.0.8)

number_slider = Slider(1.75, range=0..10)
number_slider_2 = Slider(1.85, range=0..10)
spacing_vert = Number(number_slider)
spacing_horiz = Number(number_slider_2)
series = Series(Start=0, Step=spacing_vert, Count=Slider(3, range=0..10))
series_2 = Series(Start=0, Step=spacing_horiz, Count=Slider(6, range=0..10))
pt = ConstructPoint(XCoordinate=0, YCoordinate=series, ZCoordinate=0)
panel = Panel("column")
X = UnitX(Factor=series_2)
move = Move(Geometry=pt, Motion=graft(X))  # -> simplify(Geometry), Transform

# ---- group: stagger
outer = Slider(0, range=-3..3)
middle = Slider(1.5, range=-3..3)
ring = Slider(1.2, range=-3..3)
inner = Slider(0, range=-3..3)
pinky = Slider(0, range=-3..3)
index = Slider(0, range=-3..3)

# ----
Y = UnitY(Factor=graft([inner, index, middle, ring, pinky, outer]))
move_2 = Move(Geometry=move.Geometry, Motion=Y)  # -> Geometry, Transform

# ---- group: shift
middle_2 = Slider(-0.05, range=-1..1)
ring_2 = Slider(-0.1, range=-1..1)
pinky_2 = Slider(-0.15, range=-1..1)
outer_2 = Slider(-0.15, range=-1..1)
inner_2 = Slider(0, range=-1..1)
index_2 = Slider(0, range=-1..1)

# ----
pt_2 = Point(move_2.Geometry)
X_2 = UnitX(Factor=graft([inner_2, index_2, middle_2, ring_2, pinky_2, outer_2]))
move_3 = Move(Geometry=pt_2, Motion=X_2)  # -> Geometry, Transform
pt_3 = Point(move_3.Geometry)
num = Number(number_slider)
num_2 = Number(number_slider_2)

# ---- group: splay
number_slider_3 = Slider(-3, range=-30..30)

# ----
dom = ConstructDomain(DomainStart=expr("-x/2", num_2), DomainEnd=expr("x/2", num_2))
dom_2 = ConstructDomain(DomainStart=expr("-x/2", num), DomainEnd=expr("x/2", num))
pt_4 = Point(pt_3)
panel_2 = Panel(dom)
item = ListItem(List=flatten(pt_4), Index=0, Wrap=True)
rectangle = Rectangle(Plane=pt_4, XSize=dom, YSize=dom_2, Radius=0)  # -> Rectangle, Length
num_3 = Number([number_slider_3, Slider(-3, range=-30..30), Slider(0, range=-30..30), Slider(3, range=-30..30), Slider(6, range=-30..30), Slider(6, range=-30..30)])
rad = Radians(Degrees=graft(num_3))  # -> expr("-x", Radians)
rotate = Rotate(Geometry=rectangle.Rectangle, Angle=rad, Plane=item)  # -> Geometry, Transform
flip = FlipMatrix(Data=rotate.Geometry)
pcen = PolygonCenter(Polyline=rotate.Geometry)  # -> CenterV, CenterE, CenterA
number_slider_4 = Slider(1.4, range=0..10)
item_2 = ListItem(List=flip, Index=0, Wrap=True)  # -> flatten(Item)
prot = RotatePlane(Plane=pcen.CenterV, Angle=rad)
rad_2 = Radians(Degrees=Slider(90, range=0..100))
item_3 = ListItem(List=item_2, Index=0, Wrap=True)
pcen_2 = PolygonCenter(Polyline=item_2)  # -> CenterV, CenterE, CenterA
dom_3 = ConstructDomain(DomainStart=expr("-x/2", number_slider_4), DomainEnd=expr("x/2", number_slider_4))
rotate_2 = Rotate(Geometry=item_2, Angle=rad_2, Plane=item_3)  # -> Geometry, Transform
item_4 = ListItem(List=pcen_2.CenterV, Index=1, Wrap=True)
item_5 = ListItem(List=pcen_2.CenterV, Index=0, Wrap=True)
rectangle_2 = Rectangle(Plane=prot, XSize=dom_3, YSize=dom_3, Radius=0)  # -> Rectangle, Length
rad_3 = Radians(Degrees=Slider(9, range=0..100))
vec2pt = Vector2Pt(PointA=item_4, PointB=item_5, Unitize=False)  # -> Vector, Length
amp = Amplitude(Vector=vec2pt.Vector, Amplitude=Slider(2.58, range=0..10))
rotate_3 = Rotate(Geometry=rotate_2.Geometry, Angle=rad_3, Plane=item_3)  # -> Geometry, Transform
move_4 = Move(Geometry=rotate_3.Geometry, Motion=amp)  # -> Geometry, Transform
pcen_3 = PolygonCenter(Polyline=move_4.Geometry)  # -> CenterV, CenterE, CenterA
item_6 = ListItem(List=pcen_3.CenterV, Index=1, Wrap=True)
item_7 = ListItem(List=pcen_3.CenterV, Index=0, Wrap=True)
vec2pt_2 = Vector2Pt(PointA=item_6, PointB=item_7, Unitize=False)  # -> Vector, Length
amp_2 = Amplitude(Vector=vec2pt_2.Vector, Amplitude=Slider(1.5, range=0..10))
move_5 = Move(Geometry=move_4.Geometry, Motion=amp_2)  # -> Geometry, Transform
rad_4 = Radians(Degrees=Slider(90, range=0..100))
number_slider_5 = Slider(1.85, range=0..10)
rad_5 = Radians(Degrees=Slider(12, range=0..100))
number_slider_6 = Slider(1.4, range=0..10)
dom_4 = ConstructDomain(DomainStart=expr("-x/2", number_slider_6), DomainEnd=expr("x/2", number_slider_6))
number_slider_7 = Slider(10, range=0..10)
neg = Negative(Value=Slider(0.25, range=0..10))
mcu = Curve(<curve referenced from the Rhino model>)
outline = Curve(<curve referenced from the Rhino model>)
runion = RegionUnion(Curves=mcu)
fillet = Fillet(Curve=outline, Radius=Slider(1, range=0..10))
offset = OffsetCurve(Curve=runion, Distance=Slider(0.2, range=0..1), Corners=1)
rdiff = RegionDifference(CurvesA=fillet, CurvesB=offset)
pcb_outline = Curve(rdiff)
rad_6 = Radians(Degrees=Slider(4.5, range=0..10))
X_3 = UnitX(Factor=expr("-x", Slider(70, range=0..100)))
crv = Curve(<curve referenced from the Rhino model>)
fillet_2 = FilletDistance(Curve=crv, Distance=Slider(1, range=0..1))

item_8 = ListItem(List=move_5.Geometry, Index=0, Wrap=True)
rad_7 = Radians(Degrees=Slider(0, range=0..10))
neg_2 = Negative(Value=rad_7)
rad_8 = Radians(Degrees=Slider(0, range=0..10))
neg_3 = Negative(Value=rad_8)

pcen_4 = PolygonCenter(Polyline=item_8)  # -> CenterV, CenterE, CenterA
rotate_4 = Rotate(Geometry=item_8, Angle=rad_4, Plane=pcen_4.CenterV)  # -> Geometry, Transform
crv_2 = Curve(rotate_4.Geometry)

explode = Explode(Curve=crv_2, Recursive=True)  # -> Segments, Vertices
item_9 = ListItem(List=explode.Vertices, Index=0, Wrap=True)
item_10 = ListItem(List=explode.Vertices, Index=1, Wrap=True)
item_11 = ListItem(List=explode.Vertices, Index=3, Wrap=True)
pl_3pt = Plane3Pt(PointA=item_9, PointB=item_10, PointC=item_11)
deplane = DeconstructPlane(Plane=pl_3pt)  # -> Origin, XAxis, YAxis, ZAxis
amp_3 = Amplitude(Vector=deplane.XAxis, Amplitude=number_slider_5)
move_6 = Move(Geometry=pl_3pt, Motion=amp_3)  # -> Geometry, Transform
prot_2 = RotatePlane(Plane=move_6.Geometry, Angle=neg_2)
orient = Orient(Geometry=crv_2, Source=pl_3pt, Target=prot_2)  # -> Geometry, Transform
deplane_2 = DeconstructPlane(Plane=prot_2)  # -> Origin, XAxis, YAxis, ZAxis
amp_4 = Amplitude(Vector=deplane_2.XAxis, Amplitude=number_slider_5)
move_7 = Move(Geometry=prot_2, Motion=amp_4)  # -> Geometry, Transform
prot_3 = RotatePlane(Plane=move_7.Geometry, Angle=neg_3)
orient_2 = Orient(Geometry=orient.Geometry, Source=prot_2, Target=prot_3)  # -> Geometry, Transform
merge = Merge(Data1=crv_2, Data2=orient.Geometry, Data3=orient_2.Geometry)

crv_3 = Curve(merge)
pcen_5 = PolygonCenter(Polyline=crv_3)  # -> CenterV, CenterE, CenterA
prot_4 = RotatePlane(Plane=pcen_5.CenterV, Angle=rad_5)
merge_2 = Merge(Data1=rotate.Geometry, Data2=crv_3)
rotate_5 = Rotate(Geometry=merge_2, Angle=degrees(Slider(-3, range=-10..21)), Plane=PlaneXY(0, 0, 0))  # -> Geometry, Transform
rectangle_3 = Rectangle(Plane=prot_4, XSize=dom_4, YSize=dom_4, Radius=0)  # -> Rectangle, Length
merge_3 = Merge(Data1=rectangle_2.Rectangle, Data2=rectangle_3.Rectangle)
rotate_6 = Rotate(Geometry=merge_3, Angle=degrees(Slider(-3, range=-10..21)), Plane=PlaneXY(0, 0, 0))  # -> Geometry, Transform
scale = Scale(Geometry=rotate_5.Geometry, Center=Point(0, 0, 0), Factor=number_slider_7)  # -> Geometry, Transform
scale_2 = Scale(Geometry=rotate_6.Geometry, Center=Point(0, 0, 0), Factor=number_slider_7)  # -> Geometry, Transform
containter = Curve(scale.Geometry)
explode_2 = Explode(Curve=scale_2.Geometry, Recursive=True)  # -> Segments, Vertices
len = Length(Curve=explode_2.Segments)
panel_3 = Panel(len)
offset_2 = OffsetCurve(Curve=containter, Distance=neg, Plane=PlaneXY(0, 0, 0), Corners=1)
crv_4 = Curve(flatten(offset_2))
crv_5 = Curve(flatten(scale_2.Geometry))
explode_3 = Explode(Curve=scale_2.Geometry, Recursive=True)  # -> Segments, Vertices
fillet_3 = Fillet(Curve=crv_4, Radius=Slider(1, range=0..1))
explode_4 = Explode(Curve=crv_4, Recursive=True)  # -> Segments, Vertices
len_2 = Length(Curve=explode_4.Segments)
len_3 = Length(Curve=explode_3.Segments)
panel_4 = Panel(len_2)
panel_5 = Panel(len_3)

# ---- group: switches
pcen_6 = PolygonCenter(Polyline=[scale_2.Geometry, mcu])  # -> CenterV, CenterE, CenterA
cir = Circle(Plane=pcen_6.CenterV, Radius=Slider(5, range=0..10))

# ---- group: Diodes
panel_6 = Panel("""0
25
26""")
item_12 = ListItem(List=scale_2.Geometry, Index=panel_6, Wrap=True)
cull_i = CullIndex(List=scale_2.Geometry, Indices=panel_6, Wrap=True)
rad_9 = Radians(Degrees=Slider(270, range=0..1000))
pcen_7 = PolygonCenter(Polyline=item_12)  # -> CenterV, CenterE, CenterA
rotate_7 = Rotate(Geometry=graft(item_12), Angle=graft(rad_9), Plane=graft(pcen_7.CenterV))  # -> Geometry, Transform
merge_4 = Merge(Data1=cull_i, Data2=rotate_7.Geometry)
hframe = HorizontalFrame(Curve=merge_4, Parameter=graft(Slider(0.5, range=0..1)))
deplane_3 = DeconstructPlane(Plane=hframe)  # -> Origin, XAxis, YAxis, ZAxis
neg_4 = Negative(Value=Slider(0, range=0..10))
amp_5 = Amplitude(Vector=deplane_3.YAxis, Amplitude=neg_4)
neg_5 = Negative(Value=amp_5)
move_8 = Move(Geometry=deplane_3.Origin, Motion=neg_5)  # -> Geometry, Transform
cullpt = CullDuplicates(Points=flatten(move_8.Geometry), Tolerance=0.1, CullMode=3)  # -> Points, Indices, Valence
cir_2 = Circle(Plane=cullpt.Points, Radius=Slider(2.25, range=0..10))

# ---- group: power
item_13 = ListItem(List=scale_2.Geometry, Index=Slider(18, range=0..100), Wrap=True)
explode_5 = Explode(Curve=item_13, Recursive=True)  # -> Segments, Vertices
item_14 = ListItem(List=explode_5.Segments, Index=Slider(1, range=0..100), Wrap=True)
neg_6 = Negative(Value=Slider(7.5, range=0..10))
hframe_2 = HorizontalFrame(Curve=item_14, Parameter=Slider(0, range=0..1))
deplane_4 = DeconstructPlane(Plane=hframe_2)  # -> Origin, XAxis, YAxis, ZAxis
amp_6 = Amplitude(Vector=deplane_4.XAxis, Amplitude=neg_6)
move_9 = Move(Geometry=deplane_4.Origin, Motion=amp_6)  # -> Geometry, Transform
amp_7 = Amplitude(Vector=deplane_4.YAxis, Amplitude=Slider(0.2, range=0..10))
move_10 = Move(Geometry=move_9.Geometry, Motion=amp_7)  # -> Geometry, Transform
cir_3 = Circle(Plane=move_10.Geometry, Radius=Slider(2, range=0..10))

# ----
merge_5 = Merge(Data1=cir, Data2=cir_2, Data3=cir_3, Data4=pcb_outline, Data5=crv_5)
rotate_8 = Rotate(Geometry=merge_5, Angle=rad_6, Plane=PlaneXY(0, 0, 0))  # -> Geometry, Transform
mirror = Mirror(Geometry=rotate_8.Geometry, Plane=PlaneYZ(0, 0, 0))  # -> Geometry, Transform
move_11 = Move(Geometry=mirror.Geometry, Motion=X_3)  # -> Geometry, Transform
merge_6 = Merge(Data1=rotate_8.Geometry, Data2=move_11.Geometry)
crv_6 = Curve(merge_6)
